# Grasshopper definition livability python.gh (Grasshopper 1.0.7)

# livability
# transport
# Fulfilled when at least 1 object is accessible
points_fot_this_livability_category = Panel("20")
of_points_that_the_indicator_gets_when_f = Panel("0.33")  # "% of points that the indicator gets when fulfilled"
# employment
# Fulfilled to the extent that the number of jobs correspond
# to the number of workforce (in the activity node)
points_fot_this_livability_category_2 = Panel("20")
of_points_that_the_indicator_gets_when_f_2 = Panel("100")  # "% of points that the indicator gets when fulfilled"

# ---- group: can be estimated for different landuses separately
area_of_accessible_retail_landuse = Panel("5500")
jobs_per_100_qsm = Panel("8")

# ----
workforce_ppl = Panel("550")
# social infrastructure
# Fulfilled if the threshold of accessible area is reached
points_fot_this_livability_category_3 = Panel("20")
of_points_that_the_indicator_gets_when_f_3 = Panel("25")  # "% of points that the indicator gets when fulfilled"
area_edu = Panel("250")
area_health = Panel("150")
area_culture = Panel("200")
area_sport = Panel("300")

# ---- group: is accessible?
mm = BooleanToggle(True)
drt = BooleanToggle(True)
mrt = BooleanToggle(True)

# ---- group: tresholds
tr_culture = Panel("300")
tr_edu = Panel("300")
tr_health = Panel("100")
tr_sport = Panel("300")

# ----
transport = GhPythonScript(
    points=points_fot_this_livability_category,
    MMshare=of_points_that_the_indicator_gets_when_f,
    DRTshare=of_points_that_the_indicator_gets_when_f,
    MRTshare=of_points_that_the_indicator_gets_when_f,
    MM=mm,
    DRT=drt,
    MRT=mrt)  # -> output, score_out
# ---------- transport: Python ----------
__author__ = "anast"
__version__ = "2023.04.20"

import rhinoscriptsyntax as rs

score=0
ipointsMM = points*MMshare
ipointsDRT = points*DRTshare
ipointsMRT = points*MRTshare

if MM==True:
    score=score+ipointsMM

if DRT==True:
    score=score+ipointsDRT

if MRT==True:
    score=score+ipointsMRT

score_out = score
# ---------- end transport ----------

# ---- group: SOCIAL
transport_2 = GhPythonScript(
    points=points_fot_this_livability_category_3,
    share=of_points_that_the_indicator_gets_when_f_3,
    area_edu=area_edu,
    area_health=area_health,
    area_culture=area_culture,
    area_sport=area_sport,
    tr_edu=tr_edu,
    tr_health=tr_health,
    tr_culture=tr_culture,
    tr_sport=tr_sport)  # -> out, score_out
# ---------- transport_2: Python ----------
__author__ = "anast"
__version__ = "2023.04.20"

import rhinoscriptsyntax as rs

score=0
points_per_indicator = points/100*share 

if area_edu>=tr_edu:
    score=score+points_per_indicator

if area_health>=tr_health:
    score=score+points_per_indicator

if area_culture>=tr_culture:
    score=score+points_per_indicator

if area_sport>=tr_sport:
    score=score+points_per_indicator


score_out = score
# ---------- end transport_2 ----------

# ---- group: JOB
transport_3 = GhPythonScript(
    points=points_fot_this_livability_category_2,
    share=of_points_that_the_indicator_gets_when_f_2,
    area=area_of_accessible_retail_landuse,
    njobs=jobs_per_100_qsm,
    workforce=workforce_ppl)  # -> out, actualjobs, score_out
# ---------- transport_3: Python ----------
__author__ = "anast"
__version__ = "2023.04.20"

import rhinoscriptsyntax as rs

#score=0

actualjobs = area/100*njobs
points_per_indicator = points/100*share #can be different for different kinds of jobs


score = points_per_indicator*(actualjobs/(workforce))

if score > points:
    score=points

jobs_out = actualjobs
score_out = score
# ---------- end transport_3 ----------

# ----
points = Panel(transport.score_out)
actual_number_of_jobs = Panel(transport_3.actualjobs)
points_2 = Panel(transport_3.score_out)
points_3 = Panel(transport_2.score_out)
# walkability
# Fulfillment depends on if the threshold
# of accessible area is reached AND the distances
points_fot_this_livability_category_4 = Panel("20")
of_points_that_the_indicator_gets_when_f_4 = Panel("33")  # "% of points that the indicator gets when fulfilled"
area_res = Panel("550")
area_retail = Panel("400")
area_food = Panel("200")

# ---- group: treshold to be considered accessible
tr_res = Panel("600")
tr_retail = Panel("400")
tr_food = Panel("300")

# ----
# green areas
# Fulfillment depends on the proximity, accessible
#  area and a treshold for the area
points_fot_this_livability_category_5 = Panel("20")
of_points_that_the_indicator_gets_when_f_5 = Panel("100")  # "% of points that the indicator gets when fulfilled"
of_points_that_the_indicator_gets_when_f_6 = Panel("100")  # "% of points that the indicator gets when fulfilled"
accessible_area = Panel("300")
distance_m = Panel("150")
area_treshold = Panel("300")

# ---- group: min dist
dist_food = Panel("300")
dist_res = Panel("250")
dist_retail = Panel("50")

# ---- group: GREEN
transport_4 = GhPythonScript(
    points=points_fot_this_livability_category_5,
    share=of_points_that_the_indicator_gets_when_f_6,
    area=accessible_area,
    distance=distance_m,
    tr_area=area_treshold)  # -> out, score_out
# ---------- transport_4: Python ----------
__author__ = "anast"
__version__ = "2023.04.20"

import rhinoscriptsyntax as rs



distance_weight = 0.6
area_weight = 0.4

score=0
points_per_indicator = points/100*share 



percent_of_treshold = area/(tr_area/100)

if percent_of_treshold > 100:
    percent_of_treshold =100


percent_of_maxdistance = distance/(400/100)

score = ((points*area_weight)/100*percent_of_treshold) + ((points*distance_weight)/100*(100-  percent_of_maxdistance))

if distance >400: # because 400m is 5min max
    score=0

score_out = score
# ---------- end transport_4 ----------

# ---- group: WALK
transport_5 = GhPythonScript(
    points=points_fot_this_livability_category_4,
    share=of_points_that_the_indicator_gets_when_f_4,
    area_res=area_res,
    area_retail=area_retail,
    area_food=area_food,
    tr_res=tr_res,
    tr_retail=tr_retail,
    tr_food=tr_food,
    dist_res=dist_res,
    dist_retail=dist_retail,
    dist_food=dist_food)  # -> out, score_out
# ---------- transport_5: Python ----------
__author__ = "anast"
__version__ = "2023.04.20"

import rhinoscriptsyntax as rs



distance_weight = 0.6
area_weight = 0.4

points_share = points/100*share #points per land use

score=0




percent_of_maxdistance_res = dist_res/(400/100)
percent_of_maxdistance_retail = dist_retail/(400/100)
percent_of_maxdistance_food = dist_food/(400/100)

percent_of_treshold_res = area_res/(tr_res/100)
percent_of_treshold_retail = area_retail/(tr_retail/100)
percent_of_treshold_food = area_food/(tr_food/100)



score_res = ((points_share*area_weight)/100*percent_of_treshold_res) + ((points_share*distance_weight)/100*(100-  percent_of_maxdistance_res))
score_retail = ((points_share*area_weight)/100*percent_of_treshold_retail) + ((points_share*distance_weight)/100*(100-  percent_of_maxdistance_retail))
score_food = ((points_share*area_weight)/100*percent_of_treshold_food) + ((points_share*distance_weight)/100*(100-  percent_of_maxdistance_food))

score= score_res + score_retail + score_food

if dist_res  >400 or dist_retail >400 or dist_food >400: # because 400m is 5min max
    score=0



score_out = score
# ---------- end transport_5 ----------

# ----
points_4 = Panel(transport_4.score_out)
points_5 = Panel(transport_5.score_out)
ma = MassAddition(Input=[points_4, points_5, points, points_2, points_3])  # -> Result, PartialResults
total = Panel(ma.Result)
